# Grasshopper definition assignment_Julien_Robinet.gh (Grasshopper 1.0.7)
# plug-ins: Hops, Kangaroo2 Components

# ---- group: shortestPath
msphere = MeshSphere(Base=PlaneXY(0, 0, 0), Radius=10, UCount=10, VCount=20)
concat = Concatenate(FragmentA="http://127.0.0.1:5000", FragmentB="/shortestpath")
triremesh = TriRemesh(Geometry=msphere, Iterations=25)  # -> Triangulation, Dual, Creases
panel = Panel(concat)
hops = Hops(
    _Path=concat,
    InputMesh=triremesh.Triangulation,
    FaceIndex1=Slider(3, range=0..10),
    FaceIndex2=Slider(124, range=0..1000),
    CacheResultsInMemory=True,
    CacheSolveResults=True,
    RemoteDefinitionLocation="http://127.0.0.1:5000/shortestpath",
    RemoteSolveVersion=(0, 1, 0),
    ShowInput_Enabled=False,
    ShowInput_Path=True,
    SynchronousSolve=True)
explodemesh = GhPythonScript(m=triremesh.Triangulation)  # -> out, a; inputs m: Mesh
# ---------- explodemesh: Python ----------
import Rhino.Geometry as rg

ghenv.Component.Message = "explode mesh"

exploded = []

for i in range(m.Faces.Count):
    m_copy = m.Duplicate()
    face = m_copy.Faces.ExtractFaces([i])
    exploded.append(face)
    
a = exploded
# ---------- end explodemesh ----------
item = ListItem(List=explodemesh.a, Index=hops, Wrap=True)

# ---- group: gridMesh
concat_2 = Concatenate(FragmentA="http://127.0.0.1:5000", FragmentB="/gridMesh")
panel_2 = Panel(concat_2)
hops_2 = Hops(
    _Path=concat_2,
    U=Slider(10, range=0..10),
    V=Slider(9, range=0..10),
    CacheResultsInMemory=True,
    CacheSolveResults=True,
    RemoteDefinitionLocation="http://127.0.0.1:5000/gridMesh",
    RemoteSolveVersion=(0, 1, 0),
    ShowInput_Enabled=False,
    ShowInput_Path=True,
    SynchronousSolve=True)
panel_3 = Panel(hops_2)
