# Grasshopper definition MPDA22-session03_hops.gh (Grasshopper 1.0.7)
# plug-ins: Kangaroo2 Components, Hops

subd = SubD(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)
meshsubd = MeshFromSubD(SubD=subd, Density=Slider(0, range=0..2))
triremesh = TriRemesh(Geometry=meshsubd, Length=Slider(2, range=1..2), Iterations=25)  # -> Triangulation, Dual, Creases
data = Data(triremesh.Triangulation)
data_2 = Data(meshsubd)
clean = CombineClean(Meshes=data_2)
explodemesh = GhPythonScript(m=clean)  # -> out, a; inputs m: Mesh
# ---------- explodemesh: Python ----------
import Rhino.Geometry as rg

ghenv.Component.Message = "explode mesh"

exploded = []

for i in range(m.Faces.Count):
    m_copy = m.Duplicate()
    face = m_copy.Faces.ExtractFaces([i])
    exploded.append(face)
    
a = exploded
# ---------- end explodemesh ----------
pop2d = Populate2D(Region={Plane=PlaneXY(0, 0, 0), Size=Domain2(u=0..20, v=0..10)}, Count=Slider(4, range=0..10), Seed=1)
concat = Concatenate(FragmentA="http://127.0.0.1:5000", FragmentB="/meshFromPoints")
concat_2 = Concatenate(FragmentA="http://127.0.0.1:5000", FragmentB="/meshgraph")
concat_3 = Concatenate(FragmentA="http://127.0.0.1:5000", FragmentB="/shortestpath")
panel = Panel(concat_2)
panel_2 = Panel(concat)
panel_3 = Panel(concat_3)
hops = Hops(
    _Path=concat_2,
    InputMesh=data,
    Plot=Toggle(False),
    Save=Toggle(False),
    CacheResultsInMemory=False,
    CacheSolveResults=False,
    RemoteDefinitionLocation="http://127.0.0.1:5000/meshgraph",
    RemoteSolveVersion=(0, 1, 0),
    ShowInput_Enabled=False,
    ShowInput_Path=True,
    SynchronousSolve=True)
hops_2 = Hops(
    _Path=concat,
    Points=pop2d,
    CacheResultsInMemory=False,
    CacheSolveResults=False,
    RemoteDefinitionLocation="http://127.0.0.1:5000/meshFromPoints",
    RemoteSolveVersion=(0, 1, 0),
    ShowInput_Enabled=False,
    ShowInput_Path=True,
    SynchronousSolve=True)
hops_3 = Hops(
    _Path=concat_3,
    InputMesh=data,
    CacheResultsInMemory=False,
    CacheSolveResults=False,
    RemoteDefinitionLocation="http://127.0.0.1:5000/shortestpath",
    RemoteSolveVersion=(0, 1, 0),
    ShowInput_Enabled=False,
    ShowInput_Path=True,
    SynchronousSolve=True)
panel_4 = Panel(hops_2)
